# Grasshopper definition GeoOpt-01-Varun-Mehta.gh (Grasshopper 1.0.7)
# plug-ins: Bifocals

# GeOpt-01-Varun-Mehta
# DAIS APPROACH
x = Slider(10, range=0..20)
y = Slider(10, range=0..20)
u = Slider(0, range=0..10)
v = Slider(1, range=0..10)
# 1. list
series = Series(Start=0, Step=1, Count=Slider(10, range=0..10))
python = GhPythonScript(x=x, y=y, u=u, v=v)  # -> out, a, b, c, d, e, f, g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; inputs x: Int32, y: Int32, u: Int32, v: Int32
# ---------- python: Python ----------
import Rhino.Geometry as rg
import ghpythonlib.treehelpers as th #this one is to import nested lists to grasshopper trees
import math #to use sine function

#create range of point for integer x

a= pointlist1= []
b= pointlist2= []
c= linelist= []

for i in range (int(x)):
    pt1= rg.Point3d(i,0,0)
    a.append(pt1)
    pt2= rg.Point3d(i,x,0)
    b.append(pt2)
    line= rg.LineCurve(pt1,pt2) #linecurve has the methd to divide by count
    c.append(line)

#-----------------#
paramlist=[]
for li in c:
    paramlist.append(li.DivideByCount(10,True)) #just devides based on parameter, doesnot create points

d=[]
for i in range(len(c)):
    lis=[]
    for j in range(len(paramlist[i])): 
        lis.append(c[i].PointAt(paramlist[i][j])) #box brackets with index number locates line and creates point at params list, which is a nested list, hence 2 indexes to locate
    d.append(lis) 

#-----------------#
movedpts= []

for i in range(len(d)):
    lis=[]
    for j in range(len(d[i])):
        
        vec= rg.Vector3d(d[i][j]) #converting points to vector
        len1= vec.Length #getting length of vector
        z= math.sin(len1) #imprted math library on top to use sine function
        vec2= rg.Vector3d(0,0,z) #moving z location of vector
        pt= d[i][j]-vec2 #subtracting the point from the vector, dont know why we did this x-x
        lis.append(pt)
    movedpts.append(lis)

e= th.list_to_tree(movedpts) #th function helps output nested lists

#-----------------#

f= curvelist=[]

for i in range(len(movedpts)):
    crv= rg.Curve.CreateInterpolatedCurve(movedpts[i],3,rg.CurveKnotStyle.Chord) #<<<<<----ISNT ALLOWING ME TO USE I FROM THE LIST EITHER X-X THATS WHY I QUERIED THE LIST:movedpts, its type and its length. Cant seem to figure whats wrong
    curvelist.append(crv)


g= rg.Brep.CreateFromLoft(f,rg.Point3d.Unset, rg.Point3d.Unset, 0, False ) #creating surface throughBrep.Createfrom Loft

#h=rg.Mesh.CreateFromBrep(g[0], rg.MeshingParameters(u, v))

#-----------------#

#movedpts is the list of points defined in our script
#u=v, which is x in this case

sorted_points= []

flattenList=[] #flattening the lisst
for ptList in movedpts:
    for pts in ptList:
        flattenList.append(pts)


for i in range (len(flattenList)-(x+2)): #not sure
    sub=[]
    if ( (i!=x and ((i+x)%(i-x)!=0)) or i==0): #this line is not that clear
        for j in range(i):
            point1= flattenList[i]
            point2= flattenList[i+1]
            point3= flattenList[i+x+2]
            point4= flattenList[i+x+1]
            sub.extend([point1,point2,point3,point4]) #extend and append are similar
        sorted_points.append(sub)


m= th.list_to_tree(sorted_points)

print (m)
print (len (sorted_points))


mesh_vertices= []
mesh_faces= []

mesh= rg.Mesh()

for p in sorted_points:
    sub=[]
    for j in range(4):
        a= mesh.Vertices.Add(p[j])  #what is going wrong here?
        sub.append(a)
    mesh_vertices.append(sub)
    

for i in mesh_vertices:
    face= rg.MeshFace(i[0],i[1],i[2],i[3])
    mesh.Faces.AddFace(face)
# ---------- end python ----------

# ---- group: 1.
# 2. points
pt = ConstructPoint(XCoordinate=series, YCoordinate=0, ZCoordinate=0)

# ----
construct_point = ConstructPoint(XCoordinate=series, YCoordinate=Slider(10, range=0..10), ZCoordinate=0)
data = Data(python.a)
data_2 = Data(python.b)
data_3 = Data(python.c)
data_4 = Data(python.d)
data_5 = Data(python.e)
data_6 = Data(python.f)
data_7 = Data(python.g)
data_8 = Data(python.h)
data_9 = Data(python.m)
explode_tree = ExplodeTree(Data=data_9)  # -> Branch0, Branch1, Branch2

# ---- group: 3.
# 3. line
ln = Line(StartPoint=pt, EndPoint=construct_point)

# ----
panel = Panel(python.d)
data_10 = Data(explode_tree.Branch2)
data_11 = Data(explode_tree.Branch1)

# ---- group: 4.
# 4. divide curve
divide = DivideCurve(Curve=ln, Count=10, Kinks=False)  # -> Points, Tangents, Parameters

# ---- group: 5.
vec = Vector(divide.Points)
vlen = VectorLength(Vector=vec)
sin = Sine(Value=vlen)
Z = UnitZ(Factor=sin)
# 5. vector
move = Move(Geometry=divide.Points, Motion=Z)  # -> Geometry, Transform

# ----
# GeOpt-01-Varun-Mehta
# DAVIDS APPROACH
x_2 = Slider(10, range=0..20)
y_2 = Slider(10, range=0..20)
u_2 = Slider(0, range=0..10)
v_2 = Slider(1, range=0..10)
python_2 = GhPythonScript(x=x_2, y=y_2, u=u_2, v=v_2)  # -> out, a, b, c, d, e, f, g, h, n; inputs x: Int32, y: Int32, u: Int32, v: Int32
# ---------- python_2: Python ----------
import Rhino.Geometry as rg
import ghpythonlib.treehelpers as th #this one is to import nested lists to grasshopper trees
import math #to use sine function

#create range of point for integer x

a= pointlist1= []
b= pointlist2= []
c= linelist= []

for i in range (int(x)):
    pt1= rg.Point3d(i,0,0)
    a.append(pt1)
    pt2= rg.Point3d(i,x,0)
    b.append(pt2)
    line= rg.LineCurve(pt1,pt2) #linecurve has the methd to divide by count
    c.append(line)

#-----------------#
paramlist=[]
for li in c:
    paramlist.append(li.DivideByCount(10,True)) #just devides based on parameter, doesnot create points

d=[]
for i in range(len(c)):
    lis=[]
    for j in range(len(paramlist[i])): 
        lis.append(c[i].PointAt(paramlist[i][j])) #box brackets with index number locates line and creates point at params list, which is a nested list, hence 2 indexes to locate
    d.append(lis) 

#-----------------#
movedpts= []

for i in range(len(d)):
    lis=[]
    for j in range(len(d[i])):
        
        vec= rg.Vector3d(d[i][j]) #converting points to vector
        len1= vec.Length #getting length of vector
        z= math.sin(len1) #imprted math library on top to use sine function
        vec2= rg.Vector3d(0,0,z) #moving z location of vector
        pt= d[i][j]-vec2 #subtracting the point from the vector, dont know why we did this x-x
        lis.append(pt)
    movedpts.append(lis)

e= th.list_to_tree(movedpts) #th function helps output nested lists

#-----------------#

f= curvelist=[]

for i in range(len(movedpts)):
    crv= rg.Curve.CreateInterpolatedCurve(movedpts[i],3,rg.CurveKnotStyle.Chord) #<<<<<----ISNT ALLOWING ME TO USE I FROM THE LIST EITHER X-X THATS WHY I QUERIED THE LIST:movedpts, its type and its length. Cant seem to figure whats wrong
    curvelist.append(crv)


g= rg.Brep.CreateFromLoft(f,rg.Point3d.Unset, rg.Point3d.Unset, 0, False ) #creating surface throughBrep.Createfrom Loft

#h=rg.Mesh.CreateFromBrep(g[0], rg.MeshingParameters(u, v))

#-----------------#

#movedpts is the list of points defined in our script
#u=v, which is x in this case


mes= rg.Mesh()

for i in range(len(movedpts)-1):
    for j in range(len(movedpts[i])-1):
        m= rg.Mesh()
        v1= movedpts[i][j]
        v2= movedpts[i][j+1]
        v3= movedpts[i+1][j+1]
        v4= movedpts[i+1][j]
        
        m.Vertices.Add(v1)
        m.Vertices.Add(v2)
        m.Vertices.Add(v3)
        m.Vertices.Add(v4)
        
        m.Faces.AddFace(0,1,2,3)
        
        mes.Append(m) # "A" needs to be capital
        

n=mes

#remove extra or duplicate points

mes.Vertices.CullUnused()
mes.Weld(3.14)

#Face Normals

mes.FaceNormals.ComputeFaceNormals()
mes.Normals.ComputeNormals()
# ---------- end python_2 ----------

# ---- group: 6.
# 6. curve
intcrv = Interpolate(Vertices=move.Geometry, Degree=3, Periodic=False, KnotStyle=1)  # -> Curve, Length, Domain

# ----
data_12 = Data(python_2.a)
data_13 = Data(python_2.b)
data_14 = Data(python_2.c)
data_15 = Data(python_2.d)
data_16 = Data(python_2.e)
data_17 = Data(python_2.f)
data_18 = Data(python_2.g)
data_19 = Data(python_2.n)
panel_2 = Panel(data_19)
panel_3 = Panel(python_2.d)

# ---- group: 7.
# 7. surface
loft = Loft(
    Curves=flatten(intcrv.Curve),
    Options={Adjust=False, Closed=False, LoftEnds=0, LoftSimp=0, LoftType=0, Rebuild=10, Refit=0.01})

# ---- group: 8.
# 8. mesh
mesh_uv = MeshSurface(Surface=loft, UCount=Slider(10, range=0..10), VCount=Slider(7, range=0..10), Overhang=True, Equalize=False)

# ----
# pseudo-code with hints
python_3 = GhPythonScript()  # -> out, a, b, c, d, e, f, g
# ---------- python_3: Python ----------
#you will need all this libraries
import Rhino.Geometry as rg
import ghpythonlib.treehelpers as th #this one is to import nested lists to grasshopper trees
import math


#----------------------------------------------------------
#1.- create first series of points -
#start by initializing an empty list and fill it with points 
#by creating points with a for loop. The number of points should come 
#from a grasshopper slider
#Increment the X coordinate of the point at each iteration so to create
#a series of points along the X axis line
#store that point to the list
#output this list to grasshopper to verify the result should look like gh component (1.)

pointList1 = []

#your code here


a = pointList1

#----------------------------------------------------------
#2. - create second series of points -
#create a second list of points  by copying the code above, but this time
#assign the Y coordinate of each point to a value that comes from an 
#external input which can be a slider in grasshopper
#output that list as well, the result should look like component (2.) 

pointList2 = []

#your code here

b = pointList2


#----------------------------------------------------------
#3. - create lines from two serie of points - 
#initialize another empty list to store some lines
#make another for loop that iterates through each point in any of the list BY INDEX
#within this loop, make a line that draws from points in both lists with the same index
#and append that line to the line list. output the result
#hint: you only need one for loop for this

lineList = []

#your code here


c = lineList

#----------------------------------------------------------
#4.- divide curve -
#initialize another empty list to store some curves
#interate through every line in the line list with a for loop 
#inside the scope of this for loop, create an empty list to store the division points
#inside the for loop, convert each line to a nurbs curve, like shown in class
#divide the new curve into 10 points by applying DivideByCount() method (see rhinocommo) and store the result
#this returns a list of parameters in the line which correspond to each parameter
#you need to iterate through the list of params with another for loop and get the point per each param 
#using Line.PointAt(), and there the points in the list of divison points

allDivPts = [] #this will be a list of lists
for line in lineList:
    linePts =[] #create an empty list to fill each iteration
    #some code goes here....
    
    
    
    for p in params:
        #some code goes here....
        
        linePts.append(divPt)

    #here you return to the scope of the first for loop
    allDivPts.append(linePts) #append the list of points PER LINE to another list

d = th.list_to_tree(allDivPts) #this is how you output nested lists to gh trees

#----------------------------------------------------------
#5.- apply sine function to points
#here we will use the sin() the math library to move the points in Z, 
#it makes sense to follow the logic of group 5. of gh components
#first, create a nested for loop to iterate the nested list by index (I´ve done that for you)
#second, transfor the pt to a vector3d
#third, get the vector length (it´s one of it´s properties)
#forth, create a variable that will be the magnitude of displacement, by passign the vector length to the math.sin() function
#fifth, create another 3d vector, which is is the Z vector times the previous variable
#sixth, get a new point by substracting the point to the vector (literally, a point - a vector results in another point)
#finally, append that point to a list, and then append that list to the nested list


allMovedPts = [] #list of all moved points
for list in allDivPts:
    movedPts= [] #list of moved points
    #some code goes here....
    
    
    for pt in list:
        #some code goes here....


        movedPts.append(newPt)
    movedPts.append(sinePts)

d = th.list_to_tree(movedPts) #output list of list to gh

#----------------------------------------------------------
#6.- make a curve from a list of points
#again, initialize a en empty list which will contain curves
#interate through the list of list of points with a for loop
#create a curve with rg.Curve.CreateInterpolatedCurve() as in 6. (see rhinocommon)
#append that curve to the list of curves and output it to gh

#make a curve from list of points
curveList = []

#your code goes here

e= curveList

#----------------------------------------------------------
# 7.- create a loft surface from curves
#use rg.Brep.CreateFromLoft() (see rc) to create a surface from loft
#store it in a variable and output it to gh



f = surface
#----------------------------------------------------------
#8.- create a mesh from Breo
#The last step is to create a mesh from a Brep using rg.Mesh.CreateFromBrep(), store it and output it to gh
#keep in mind that CreateFromBrep needs one Brep and CreateFromLoft() returns a list (even if only of one element)

g = mesh

#THE END
# ---------- end python_3 ----------
