# Grasshopper definition AIA_GeoOpt_Assignment02_setup.gh (Grasshopper 1.0.7)

# Assignment 2
ghpython_script = GhPythonScript(x=Slider(10, range=1..20), y=Slider(10, range=1..20), U=Slider(20, range=1..20), V=Slider(20, range=1..20))  # -> out, a, c, d, e, f, g, h; inputs x: Int32, U: Int32, V: Int32
# ---------- ghpython_script: Python ----------
import Rhino.Geometry as rg
import ghpythonlib.treehelpers as th
import math
import ghpythonlib.components as ghc

#this is how you initialize a list in python
pointList1 = []
pointList2 = []
for i in range(x):
    pt1 = rg.Point3d(i, 0, 0)
    pt2 = rg.Point3d(i, y, 0)
    pointList1.append(pt1)
    pointList2.append(pt2)

a = pointList1

lineList = []
for i in range(len(pointList1)):
    line = rg.Line(pointList1[i], pointList2[i])
    lineList.append(line)
c = lineList


allDivPts = []
for l in lineList:
    divPts = [] #my list of division points
    nc = l.ToNurbsCurve()
    params = nc.DivideByCount(V, True)
    for p in params:
        divPt = nc.PointAt(p)
        
        vec= rg.Vector3d(divPt)
        vecLen = vec.Length
        mag = math.sin(vecLen)
        transVec = -rg.Vector3d.ZAxis * mag
        
        newPt = divPt - transVec
        divPts.append(newPt)

    allDivPts.append(divPts)

d = th.list_to_tree(allDivPts)


#make a curve from list of points
curveList = []
for i in range(len(allDivPts)):
    curve = rg.Curve.CreateInterpolatedCurve(allDivPts[i], 3)
    curveList.append(curve)
e= curveList


#create a loft surface from curves
surface = rg.Brep.CreateFromLoft(curveList, rg.Point3d.Unset, rg.Point3d.Unset, rg.LoftType.Normal, False)
surface = surface[0].Faces[0]

f = surface

#reparametrize surface
surface.SetDomain(0,rg.Interval(0,U))
surface.SetDomain(1,rg.Interval(0,V))

#get points
allSrfPts=[]
for i in range(U+1):
    srfPts= []
    for j in range(V+1):
        pt=rg.Surface.PointAt(surface,i,j)
        srfPts.append(pt)
    allSrfPts.append(srfPts)
h = allSrfPts


mesh = rg.Mesh()
for i in range(len(allSrfPts)-1):
    for j in range(len(allSrfPts[i])-1):
        m = rg.Mesh()
        v1 = allSrfPts[i][j]
        v2 = allSrfPts[i][j+1]        
        v3 = allSrfPts[i+1][j+1]        
        v4 = allSrfPts[i+1][j]
        
        m.Vertices.Add(v1)
        m.Vertices.Add(v2)
        m.Vertices.Add(v3)
        m.Vertices.Add(v4)
        
        m.Faces.AddFace(0,1,2,3)
        
        mesh.Append(m)

g = mesh

cleanmesh = mesh
#methods to clean a mesh
cleanmesh.Normals.ComputeNormals()
cleanmesh.Vertices.CombineIdentical(True, True)
cleanmesh.Vertices.CullUnused()
cleanmesh.Weld(3.14159265358979)
cleanmesh.UnifyNormals()
cleanmesh.FaceNormals.ComputeFaceNormals()
cleanmesh.Compact()


h = cleanmesh
# ---------- end ghpython_script ----------
file_path = FilePath("C:\Users\varun\Desktop\GOPT\Class 2\GeoOpt VS code workflow\GeoOpt\A02\GeoOpt-02.2-Varun-Mehta.py")
read_file = ReadFile(File=file_path, PerLineParse=False)

# ---- group: create sun Vector
ghpython_script_2 = GhPythonScript(Code=read_file, X=Slider(0.45, range=0..1), Y=Slider(0.6, range=0..1))  # -> Out, A, B, C

# ---- group: replaceable mesh
mesh = Data(ghpython_script.h)

# ----
panel = Panel(ghpython_script_2.Out)
data = Data(ghpython_script_2.A)
data_2 = Data(ghpython_script_2.B)
data_3 = Data(ghpython_script_2.C)

# ---- group: your .py file goes here
file_path_2 = FilePath("C:\Users\varun\Desktop\GOPT\Class 2\GeoOpt VS code workflow\GeoOpt\A02\GeoOpt-02.1-Varun-Mehta.py")

# ----
vector_display = VectorDisplay(Anchor=ghpython_script_2.B, Vector=ghpython_script_2.C)
read_file_2 = ReadFile(File=file_path_2, PerLineParse=False)
panel_2 = Panel(read_file_2)
ghpython_script_3 = GhPythonScript(Code=read_file_2, M=mesh, S=ghpython_script_2.C)  # -> Out, A, B, C, D, E, F
bounds = Bounds(Numbers=ghpython_script_3.C)
# Face Normals
data_4 = Data(ghpython_script_3.A)
# Centers
data_5 = Data(ghpython_script_3.B)
# Angles
data_6 = Data(ghpython_script_3.C)
# Exploded Faces
data_7 = Data(ghpython_script_3.D)
data_8 = Data(ghpython_script_3.E)
data_9 = Data(ghpython_script_3.F)
panel_3 = Panel(ghpython_script_3.Out)
deconstruct_domain = DeconstructDomain(Domain=bounds)  # -> Start, End
vector_display_2 = VectorDisplay(Anchor=ghpython_script_3.B, Vector=ghpython_script_3.A)
gradient = Gradient(
    LowerLimit=deconstruct_domain.Start,
    UpperLimit=deconstruct_domain.End,
    Parameter=ghpython_script_3.C,
    stops=[0: RGB(234, 38, 0), 0.25: RGB(234, 126, 0), 0.5: RGB(254, 244, 84), 0.75: RGB(173, 203, 249), 1: RGB(75, 107, 169)])
panel_4 = Panel(data_9)
list_item = ListItem(List=data_7, Index=Slider(131, range=1..300), Wrap=True)
custom_preview = CustomPreview(Geometry=ghpython_script_3.D, Material=gradient)
